# Grasshopper definition reciprocal_frame_v2.gh (Grasshopper 0.9.76)
# plug-ins: Python Interpreter

engagement_length = Slider(1.302, range=0..3)
eccentricity = Slider(0.452, range=0..1)

# ---- group: d2
X = Slider(2.611, range=0..4)
Z = Slider(0.89, range=0..4)
Y = Slider(0.649, range=0..4)

# ---- group: d1
X_2 = Slider(2.118, range=0..4)
Y_2 = Slider(1.936, range=0..4)
Z_2 = Slider(0.89, range=0..4)

# ---- group: d3
X_3 = Slider(1.25, range=0..4)
Y_3 = Slider(0.864, range=0..4)
Z_3 = Slider(0.888, range=0..4)

# ----
python = PythonScript(
    o="-1, -1, 0",
    a="0, 0, 0",
    d1x=X_2,
    d1y=Y_2,
    d1z=Z_2,
    b="2, 3.4641, 0",
    d2x=X,
    d2y=Y,
    d2z=Z,
    c="4, 0, 0",
    d3x=X_3,
    d3y=Y_3,
    d3z=Z_3,
    Engagement=engagement_length,
    Eccentricity=eccentricity)  # -> out, add
# ---------- python: Python ----------
#Definição das três barras e respectivas distâncias através de vetores

import rhinoscriptsyntax as rs

#PRIMEIRA PARTE construindo pontos (fixos e variáveis)
o = rs.AddPoint(-1, -1, 0)

a = rs.AddPoint(0, 0, 0)
d1 = rs.AddPoint(d1x, d1y, d1z)

b = rs.AddPoint(2, 3.4641, 0)
d2 = rs.AddPoint(d2x, d2y, d2z)

c = rs.AddPoint(4, 0, 0)
d3 = rs.AddPoint(d3x, d3y, d3z)

#TAREFA:devo criar uma lista para fazer um while ou for para chamar as funções automáticamente

def cria_vetor(arg_1, arg_2):
    """Criando vetores"""
    return rs.VectorCreate(arg_1, arg_2)

def reverte_vetor(arg_1):
    """Reverte valor de um vetor"""
    return rs.VectorReverse(arg_1)

def tamanho_vetor(arg_1):
    """Comprimento de um vetor"""
    return rs.VectorLength(arg_1)

fun_1 = cria_vetor(o, d1)
print(fun_1)
fun_2 = reverte_vetor(fun_1)
print(fun_2)


#SEGUNDA PARTE criando vetores
od1_T = rs.VectorCreate(o, d1) #vector True
od1 = rs.VectorReverse(od1_T)#vector False
#len_od1 = rs.VectorLength(od1) 
d1a_T = rs.VectorCreate(d1, a)
d1a = rs.VectorReverse(d1a_T)
len_d1a = rs.VectorLength(d1a)#retorna tamanho do vector


od2_T = rs.VectorCreate(o, d2)
od2 = rs.VectorReverse(od2_T)
#len_od2 = rs.VectorLength(od2)
d2b_T = rs.VectorCreate(d2, b)
d2b = rs.VectorReverse(d2b_T)
len_d2b = rs.VectorLength(d2b)

od3_T = rs.VectorCreate(o, d3)
od3 = rs.VectorReverse(od3_T)
#len_od3 = rs.VectorLength(od3)
d3c_T = rs.VectorCreate(d3, c)
d3c = rs.VectorReverse(d3c_T)
len_d3c = rs.VectorLength(d3c)


#TERCEIRA PARTE
exp = (len_d1a + len_d2b + len_d3c)/3 #Expression component

"""primeira barra - repete isso 3 vezes"""
div = exp / len_d1a #dividindo exp por len_d1a
#print(div)
mult = d1a * div
#print(mult)
Vlen = rs.VectorLength(mult)
#print(Vlen)

#D1A*lamba/L
mult_2 = mult * Eccentricity
add = od1 + mult_2


#D1A*D3C
#vector_cross = rs.VectorCrossProduct(mult, #este outro argumemento ainda não construi)
# ---------- end python ----------
galapagos = Galapagos(fitness=division_10, gene=[X_6, Y_6, X_4, Y_4, X_5, Y_5, Z_4, Z_5, Z_6])

Z_4 = Slider(0.983, range=0..4)
X_4 = Slider(2.315, range=0..4)
Y_4 = Slider(1.243, range=0..4)
B = PointXYZ(XComponent="2", YComponent="3.4641", ZComponent="0", Plane=PlaneXY(0, 0, 0))
d2 = PointXYZ(XComponent=X_4, YComponent=Y_4, ZComponent=Z_4, Plane=PlaneXY(0, 0, 0))

X_5 = Slider(1.039, range=0..4)
Y_5 = Slider(1.51, range=0..4)
Z_5 = Slider(0.935, range=0..4)
C = PointXYZ(XComponent="4", YComponent="0", ZComponent="0", Plane=PlaneXY(0, 0, 0))
d3 = PointXYZ(XComponent=X_5, YComponent=Y_5, ZComponent=Z_5, Plane=PlaneXY(0, 0, 0))

Y_6 = Slider(2.62, range=0..4)
X_6 = Slider(1.79, range=0..4)
Z_6 = Slider(0.809, range=0..4)
A = PointXYZ(XComponent="0", YComponent="0", ZComponent="0", Plane=PlaneXY(0, 0, 0))
d1 = PointXYZ(XComponent=X_6, YComponent=Y_6, ZComponent=Z_6, Plane=PlaneXY(0, 0, 0))

# ----
# Definição das três barras e respectivas distâncias através de vetores
O = PointXYZ(XComponent="-1", YComponent="-1", ZComponent="0", Plane=PlaneXY(0, 0, 0))

od3 = Vector2Pt(PointA=O, PointB=d3, Unitize=False)  # -> Vector, Length
d3c = Vector2Pt(PointA=d3, PointB=C, Unitize=False)  # -> Vector, Length
vdis = VectorDisplay(Anchors=O, Vectors=od3.Vector)
vdis_2 = VectorDisplay(Anchors=d3, Vectors=d3c.Vector)

od2 = Vector2Pt(PointA=O, PointB=d2, Unitize=False)  # -> Vector, Length
d2b = Vector2Pt(PointA=d2, PointB=B, Unitize=False)  # -> Vector, Length
vdis_3 = VectorDisplay(Anchors=O, Vectors=od2.Vector)
vdis_4 = VectorDisplay(Anchors=d2, Vectors=d2b.Vector)

od1 = Vector2Pt(PointA=O, PointB=d1, Unitize=False)  # -> Vector, Length
d1a = Vector2Pt(PointA=d1, PointB=A, Unitize=False)  # -> Vector, Length
vdis_5 = VectorDisplay(Anchors=O, Vectors=od1.Vector)
vdis_6 = VectorDisplay(Anchors=d1, Vectors=d1a.Vector)

engagement_length_2 = Slider(1.302, range=0..3)
# Definição do comprimento e excentricidade do trabalho
# (Eles também podem ser usados
#  como variáveis de projeto)
eccentricity_2 = Slider(0.452, range=0..1)
exp = VariableExpression(a=d1a.Length, b=d2b.Length, c=d3c.Length, Expression="(a+b+c)/3")
division = Division(A=engagement_length_2, B=exp)
comprimento_médio_das_barras = Panel(exp)
taxa_de_engajamento = Panel(division)

panel = Panel(d3c.Length)
# Definição do comprimento e excentricidade do trabalho
# (Eles também podem ser usados
#  como variáveis de projeto)
eccentricity_3 = Slider(0.452, range=0..1)

division_2 = Division(A=exp, B=d3c.Length)
multiplication = Multiplication(A=d3c.Vector, B=division_2)
panel_2 = Panel(division_2)
vlen = VectorLength(Vector=multiplication)
vdis_7 = VectorDisplay(Anchors=d3, Vectors=multiplication)
panel_3 = Panel(multiplication)
panel_4 = Panel(vlen)

division_3 = Division(A=exp, B=d2b.Length)
multiplication_2 = Multiplication(A=d2b.Vector, B=division_3)
panel_5 = Panel(division_3)
vdis_8 = VectorDisplay(Anchors=d2, Vectors=multiplication_2)
panel_6 = Panel(multiplication_2)
vlen_2 = VectorLength(Vector=multiplication_2)
panel_7 = Panel(vlen_2)

division_4 = Division(A=exp, B=d1a.Length)
multiplication_3 = Multiplication(A=d1a.Vector, B=division_4)
panel_8 = Panel(division_4)
vdis_9 = VectorDisplay(Anchors=d1, Vectors=multiplication_3)
vlen_3 = VectorLength(Vector=multiplication_3)
panel_9 = Panel(multiplication_3)
panel_10 = Panel(vlen_3)

# ---- group: criando geoemtria
python_2 = PythonScript(
    d1x=X_2,
    d1y=Y_2,
    d1z=Z_2,
    d2x=X,
    d2y=Y,
    d2z=Z,
    d3x=X_3,
    d3y=Y_3,
    d3z=Z_3,
    Engagement=engagement_length,
    Eccentricity=eccentricity_3)  # -> out, cyl_1, cyl_2, cyl_3
# ---------- python_2: Python ----------
#Definição das três barras e respectivas distâncias através de vetores

import rhinoscriptsyntax as rs

#PRIMEIRA PARTE construindo pontos (fixos e variáveis)
o = rs.AddPoint(-1, -1, 0)

a = rs.AddPoint(0, 0, 0)
d1 = rs.AddPoint(d1x, d1y, d1z)

b = rs.AddPoint(2, 3.4641, 0)
d2 = rs.AddPoint(d2x, d2y, d2z)

c = rs.AddPoint(4, 0, 0)
d3 = rs.AddPoint(d3x, d3y, d3z)
#############

###### modelando geometrias######
diameter_cyl = Eccentricity / 2
print(diameter_cyl)

cyl_1 = rs.AddCylinder(a, d1, diameter_cyl, cap=True)
cyl_2 = rs.AddCylinder(b, d2, diameter_cyl, cap=True)
cyl_3 = rs.AddCylinder(c, d3, diameter_cyl, cap=True)


#############
#SEGUNDA PARTE criando vetores
od1_T = rs.VectorCreate(o, d1) #vector True
od1 = rs.VectorReverse(od1_T)#vector False
#len_od1 = rs.VectorLength(od1) 
d1a_T = rs.VectorCreate(d1, a)
d1a = rs.VectorReverse(d1a_T)
len_d1a = rs.VectorLength(d1a)#retorna tamanho do vector


od2_T = rs.VectorCreate(o, d2)
od2 = rs.VectorReverse(od2_T)
#len_od2 = rs.VectorLength(od2)
d2b_T = rs.VectorCreate(d2, b)
d2b = rs.VectorReverse(d2b_T)
len_d2b = rs.VectorLength(d2b)

od3_T = rs.VectorCreate(o, d3)
od3 = rs.VectorReverse(od3_T)
#len_od3 = rs.VectorLength(od3)
d3c_T = rs.VectorCreate(d3, c)
d3c = rs.VectorReverse(d3c_T)
len_d3c = rs.VectorLength(d3c)


#TERCEIRA PARTE
exp = (len_d1a + len_d2b + len_d3c)/3 #Expression component

"""primeira barra - ######REPETE 3X######"""
div_1 = exp / len_d1a #dividindo exp por len_d1a
#print(div_1)
mult_1 = d1a * div_1
#print(mult_1)
Vlen_1 = rs.VectorLength(mult_1)
#print(Vlen_1)

#D1A*lamba/L
mult_1_2 = mult_1 * Eccentricity
add_1 = od1 + mult_1_2

"""segunda barra"""
div_2 = exp / len_d2b #dividindo exp por len_d1a
#print(div_2)
mult_2 = d2b * div_2
#print(mult_2)
Vlen_2 = rs.VectorLength(mult_2)
#print(Vlen_2)

#D1A*lamba/L
mult_2_2 = mult_2 * Eccentricity
add_2 = d2b + mult_2_2

"""terceira barra"""
div_3 = exp / len_d3c #dividindo exp por len_d1a
#print(div_3)
mult_3 = d3c * div_3
#print(mult_3)
Vlen_3 = rs.VectorLength(mult_3)
#print(Vlen_3)

#D1A*lamba/L
mult_3_2 = mult_3 * Eccentricity
add_3 = d3c + mult_3_2


##########
##########
#D1A*D3C

vector_cross_1 = rs.VectorCrossProduct(mult_1, mult_3)
#print(vector_cross_1)
#print(len(vector_cross_1))
e_1 = vector_cross_1 * Eccentricity

lam_1 = mult_1 * Eccentricity
#print(lam_1)
add_1 = lam_1 + od1

add_1_1 = add_1 + e_1
gap_1 = od3 - add_1_1 
print(gap_1)
gap_1_abs = rs.VectorReverse(gap_1) #tem que ser absoluto. Aqui, o código volta valores trocados
print(gap_1_abs)

"""segunda barra"""
vector_cross_2 = rs.VectorCrossProduct(mult_2, mult_2)
#print(vector_cross_2)
#print(len(vector_cross_2))
e_2 = vector_cross_2 * Eccentricity

lam_2 = mult_2 * Eccentricity
#print(lam_2)
add_2 = lam_2 + od2

add_2_1 = add_2 + e_2
gap_2 = od3 - add_2_1 
print(gap_2)

"""terceira barra"""
vector_cross_3 = rs.VectorCrossProduct(mult_3, mult_2)
#print(vector_cross_3)
#print(len(vector_cross_3))
e_3 = vector_cross_3 * Eccentricity

lam_3 = mult_3 * Eccentricity
#print(lam_3)
add_3 = lam_3 + od3

add_3_1 = add_3 + e_3
gap_3 = od3 - add_3_1 
print(gap_3)
# ---------- end python_2 ----------

# ----
python_3 = PythonScript(
    d1x=X_2,
    d1y=Y_2,
    d1z=Z_2,
    d2x=X,
    d2y=Y,
    d2z=Z,
    d3x=X_3,
    d3y=Y_3,
    d3z=Z_3,
    Engagement=engagement_length,
    Eccentricity=eccentricity)  # -> out, gap_1, gap_2, gap_3
# ---------- python_3: Python ----------
#Definição das três barras e respectivas distâncias através de vetores

import rhinoscriptsyntax as rs

#PRIMEIRA PARTE construindo pontos (fixos e variáveis)
o = rs.AddPoint(-1, -1, 0)

a = rs.AddPoint(0, 0, 0)
d1 = rs.AddPoint(d1x, d1y, d1z)

b = rs.AddPoint(2, 3.4641, 0)
d2 = rs.AddPoint(d2x, d2y, d2z)

c = rs.AddPoint(4, 0, 0)
d3 = rs.AddPoint(d3x, d3y, d3z)

#SEGUNDA PARTE criando vetores
od1_T = rs.VectorCreate(o, d1) #vector True
od1 = rs.VectorReverse(od1_T)#vector False
#len_od1 = rs.VectorLength(od1) 
d1a_T = rs.VectorCreate(d1, a)
d1a = rs.VectorReverse(d1a_T)
len_d1a = rs.VectorLength(d1a)#retorna tamanho do vector


od2_T = rs.VectorCreate(o, d2)
od2 = rs.VectorReverse(od2_T)
#len_od2 = rs.VectorLength(od2)
d2b_T = rs.VectorCreate(d2, b)
d2b = rs.VectorReverse(d2b_T)
len_d2b = rs.VectorLength(d2b)

od3_T = rs.VectorCreate(o, d3)
od3 = rs.VectorReverse(od3_T)
#len_od3 = rs.VectorLength(od3)
d3c_T = rs.VectorCreate(d3, c)
d3c = rs.VectorReverse(d3c_T)
len_d3c = rs.VectorLength(d3c)


#TERCEIRA PARTE
exp = (len_d1a + len_d2b + len_d3c)/3 #Expression component

"""primeira barra - ######REPETE 3X######"""
div_1 = exp / len_d1a #dividindo exp por len_d1a
#print(div_1)
mult_1 = d1a * div_1
#print(mult_1)
Vlen_1 = rs.VectorLength(mult_1)
#print(Vlen_1)

#D1A*lamba/L
mult_1_2 = mult_1 * Eccentricity
add_1 = od1 + mult_1_2

"""segunda barra"""
div_2 = exp / len_d2b #dividindo exp por len_d1a
#print(div_2)
mult_2 = d2b * div_2
#print(mult_2)
Vlen_2 = rs.VectorLength(mult_2)
#print(Vlen_2)

#D1A*lamba/L
mult_2_2 = mult_2 * Eccentricity
add_2 = d2b + mult_2_2

"""terceira barra"""
div_3 = exp / len_d3c #dividindo exp por len_d1a
#print(div_3)
mult_3 = d3c * div_3
#print(mult_3)
Vlen_3 = rs.VectorLength(mult_3)
#print(Vlen_3)

#D1A*lamba/L
mult_3_2 = mult_3 * Eccentricity
add_3 = d3c + mult_3_2


##########
##########
#D1A*D3C

vector_cross_1 = rs.VectorCrossProduct(mult_1, mult_3)
#print(vector_cross_1)
#print(len(vector_cross_1))
e_1 = vector_cross_1 * Eccentricity

lam_1 = mult_1 * Eccentricity
#print(lam_1)
add_1 = lam_1 + od1

add_1_1 = add_1 + e_1
gap_1 = od3 - add_1_1 
print(gap_1)
gap_1_abs = rs.VectorReverse(gap_1) #tem que ser absoluto. Aqui, o código volta valores trocados
print(gap_1_abs)

"""segunda barra"""
vector_cross_2 = rs.VectorCrossProduct(mult_2, mult_2)
#print(vector_cross_2)
#print(len(vector_cross_2))
e_2 = vector_cross_2 * Eccentricity

lam_2 = mult_2 * Eccentricity
#print(lam_2)
add_2 = lam_2 + od2

add_2_1 = add_2 + e_2
gap_2 = od3 - add_2_1 
print(gap_2)

"""terceira barra"""
vector_cross_3 = rs.VectorCrossProduct(mult_3, mult_2)
#print(vector_cross_3)
#print(len(vector_cross_3))
e_3 = vector_cross_3 * Eccentricity

lam_3 = mult_3 * Eccentricity
#print(lam_3)
add_3 = lam_3 + od3

add_3_1 = add_3 + e_3
gap_3 = od3 - add_3_1 
print(gap_3)
# ---------- end python_3 ----------
abs = Absolute(Value=python_3.gap_2)

ln = Line(StartPoint=A, EndPoint=d1)
ln_2 = Line(StartPoint=C, EndPoint=d3)
ln_3 = Line(StartPoint=B, EndPoint=d2)
len = Length(Curve=ln_2)
len_2 = Length(Curve=ln_3)
len_3 = Length(Curve=ln)
division_5 = Division(A=eccentricity_2, B="2")
division_6 = Division(A=eccentricity_2, B="2")
division_7 = Division(A=eccentricity_2, B="2")
comprimento_da_barra_1 = Panel(len_3)
comprimento_da_barra_2 = Panel(len_2)
# Visualização das barras como cilindros
comprimento_da_barra_3 = Panel(len)
cyl = Cylinder(Base=ln_3, Radius=division_5, Length=len_2)
subtraction = Subtraction(A=len, B=engagement_length_2)
cyl_2 = Cylinder(Base=ln_2, Radius=division_6, Length=len)
subtraction_2 = Subtraction(A=len_3, B=engagement_length_2)
subtraction_3 = Subtraction(A=len_2, B=engagement_length_2)
cyl_3 = Cylinder(Base=ln, Radius=division_7, Length=len_3)
eval = EvaluateLength(Curve=ln, Length=subtraction_2, Normalized="False")  # -> Point, Tangent, Parameter
eval_2 = EvaluateLength(Curve=ln_3, Length=subtraction_3, Normalized="False")  # -> Point, Tangent, Parameter
eval_3 = EvaluateLength(Curve=ln_2, Length=subtraction, Normalized="False")  # -> Point, Tangent, Parameter
exp_2 = VariableExpression(a=comprimento_da_barra_1, b=comprimento_da_barra_2, c=comprimento_da_barra_3, Expression="(a+b+c)/3")
pt = Point(eval.Point)
pt_2 = Point(eval_3.Point)
pt_3 = Point(eval_2.Point)
subtraction_4 = Subtraction(A=len_3, B=exp_2)
subtraction_5 = Subtraction(A=len_2, B=exp_2)
subtraction_6 = Subtraction(A=len, B=exp_2)
abs_2 = Absolute(Value=subtraction_4)
abs_3 = Absolute(Value=subtraction_5)
abs_4 = Absolute(Value=subtraction_6)
panel_11 = Panel(abs_3)
panel_12 = Panel(abs_4)
panel_13 = Panel(abs_2)
exp_3 = VariableExpression(a=panel_13, b=panel_11, c=panel_12, Expression="(a²+b²+c²)^½")
panel_14 = Panel(exp_3)
division_8 = Division(A=panel_14, B="3")
panel_15 = Panel(division_8)

d1a_d3c = CrossProduct(VectorA=multiplication_3, VectorB=multiplication, Unitize="True")  # -> Vector, Length
d1a_lamba_l = Multiplication(A=multiplication_3, B=division)
panel_16 = Panel(d1a_lamba_l)
vdis_10 = VectorDisplay(Anchors=O, Vectors=d1a_d3c.Vector)
od3_2 = Addition(A=od1.Vector, B=d1a_lamba_l)
multiplication_4 = Multiplication(A=d1a_d3c.Vector, B=eccentricity_2)
panel_17 = Panel(multiplication_4)
vdis_11 = VectorDisplay(Anchors=O, Vectors=od3_2)
vdis_12 = VectorDisplay(Anchors=O, Vectors=multiplication_4)
panel_18 = Panel(od3_2)
od3_3 = Addition(A=od3_2, B=multiplication_4)
panel_19 = Panel(od3_3)
vdis_13 = VectorDisplay(Anchors=O, Vectors=od3_3)
gap1 = Subtraction(A=od3.Vector, B=od3_3)
abs_5 = Absolute(Value=gap1)
panel_20 = Panel(abs_5)
vdis_14 = VectorDisplay(Anchors=pt_2, Vectors=abs_5)

d3c_lamba_l = Multiplication(A=multiplication, B=division)
d3c_d2b = CrossProduct(VectorA=multiplication, VectorB=multiplication_2, Unitize="True")  # -> Vector, Length
vdis_15 = VectorDisplay(Anchors=O, Vectors=d3c_d2b.Vector)
multiplication_5 = Multiplication(A=d3c_d2b.Vector, B=eccentricity_2)
od2_2 = Addition(A=od3.Vector, B=d3c_lamba_l)
vdis_16 = VectorDisplay(Anchors=O, Vectors=multiplication_5)
vdis_17 = VectorDisplay(Anchors=O, Vectors=od2_2)
panel_21 = Panel(multiplication_5)
panel_22 = Panel(od2_2)
od2_3 = Addition(A=od2_2, B=multiplication_5)
vdis_18 = VectorDisplay(Anchors=O, Vectors=od2_3)
gap3 = Subtraction(A=od2.Vector, B=od2_3)
abs_6 = Absolute(Value=gap3)
vdis_19 = VectorDisplay(Anchors=pt, Vectors=abs_6)
# Fitness function
panel_23 = Panel(abs_6)

d2b_d1a = CrossProduct(VectorA=multiplication_2, VectorB=multiplication_3, Unitize="True")  # -> Vector, Length
d2b_lamba_l = Multiplication(A=multiplication_2, B=division)
vdis_20 = VectorDisplay(Anchors=O, Vectors=d2b_d1a.Vector)
od1_2 = Addition(A=od2.Vector, B=d2b_lamba_l)
multiplication_6 = Multiplication(A=d2b_d1a.Vector, B=eccentricity_2)
vdis_21 = VectorDisplay(Anchors=O, Vectors=multiplication_6)
vdis_22 = VectorDisplay(Anchors=O, Vectors=od1_2)
panel_24 = Panel(multiplication_6)
panel_25 = Panel(od1_2)
od1_3 = Addition(A=od1_2, B=multiplication_6)
vdis_23 = VectorDisplay(Anchors=O, Vectors=od1_3)
panel_26 = Panel(od1_3)
gap2 = Subtraction(A=od1.Vector, B=od1_3)
abs_7 = Absolute(Value=gap2)
vdis_24 = VectorDisplay(Anchors=pt_3, Vectors=abs_7)
panel_27 = Panel(abs_7)

abs_8 = Absolute(Value=python_3.gap_3)

panel_28 = Panel(python_3.gap_1)
abs_9 = Absolute(Value=panel_28)

panel_29 = Panel(d1a_d3c.Vector)
panel_30 = Panel(abs_9)
panel_31 = Panel(abs_8)
panel_32 = Panel(abs)
panel_33 = Panel(abs_5)
panel_34 = Panel(abs_7)
panel_35 = Panel(abs_6)
exp_4 = VariableExpression(Gap1=panel_33, Gap2=panel_34, Gap3=panel_35, Expression="(Gap1²+Gap2²+Gap3²)^(½)")
panel_36 = Panel(exp_4)
multiplication_7 = Multiplication(A=eccentricity_2, B="3")
exp_5 = VariableExpression(Gap1=abs_5, Gap2=abs_7, Gap3=abs_6, Expression="(Gap1²+Gap2²+Gap3²)^(½)")
division_9 = Division(A=exp_4, B=multiplication_7)
multiplication_8 = Multiplication(A=eccentricity_2, B="3")
division_10 = Division(A=exp_5, B=multiplication_8)
panel_37 = Panel(division_10)
fitness_function = Panel(division_9)

# ---- group: atual
engagement_length_3 = Slider(1.302, range=0..3)
eccentricity_4 = Slider(0.452, range=0..1)

# ---- group: atual / d1
X_7 = Slider(2.118, range=0..4)
Y_7 = Slider(1.936, range=0..4)
Z_7 = Slider(0.89, range=0..4)

# ---- group: atual / d2
X_8 = Slider(2.611, range=0..4)
Y_8 = Slider(0.649, range=0..4)
Z_8 = Slider(0.89, range=0..4)

# ---- group: atual / d3
Z_9 = Slider(0.888, range=0..4)
X_9 = Slider(1.25, range=0..4)
Y_9 = Slider(0.864, range=0..4)

# ---- group: atual / criando geoemtria
python_4 = PythonScript(
    d1x=X_7,
    d1y=Y_7,
    d1z=Z_7,
    d2x=X_8,
    d2y=Y_8,
    d2z=Z_8,
    d3x=X_9,
    d3y=Y_9,
    d3z=Z_9,
    Engagement=engagement_length_3,
    Eccentricity=eccentricity_4)  # -> out, cyl_1, cyl_2, cyl_3; same code as python_2
